# Dynamo graph Export ALL elemnts Final 2026.dyn "Export ALL elemnts Final 2025" (Dynamo 2.18.1.5096)

file_path = Filename(".\REVIT.TASK.xlsx")  # graph input

# group: Foundation
string = StringInput("Foundation.Concrete")  # graph input
number = DoubleInput(1)  # graph input
categories = Categories("OST_StructuralFoundation")  # graph input
all_elements_of_category = ElementsOfCategory(Category=categories)
watch = Watch(all_elements_of_category)
string_2 = StringInput("Level")  # graph input
getParameterValueByName = Element.GetParameterValueByName(element=watch, parameterName=string_2)
string_3 = StringInput("Volume")  # graph input
getParameterValueByName_2 = Element.GetParameterValueByName(element=watch, parameterName=string_3)
python_script = Python(IN[0]=watch)  # CPython3
# ---------- python_script.python (71 lines) ----------
# Dynamo Python 3.x - Shuttering Area for Foundations
import clr, math

# Revit API & Dynamo references
clr.AddReference("RevitAPI")
from Autodesk.Revit.DB import *
clr.AddReference("RevitServices")
from RevitServices.Persistence import DocumentManager
clr.AddReference("RevitNodes")
import Revit
clr.ImportExtensions(Revit.Elements)

doc = DocumentManager.Instance.CurrentDBDocument
FT_TO_M = 0.3048

def get_param(el, names):
    for n in names:
        p = el.LookupParameter(n)
        if p and p.StorageType != StorageType.String:
            try:
                return p.AsDouble()
            except:
                pass
    s = getattr(el, "Symbol", None)
    if s:
        for n in names:
            p = s.LookupParameter(n)
            if p and p.StorageType != StorageType.String:
                try:
                    return p.AsDouble()
                except:
                    pass
    return None

def any_3d(doc):
    for v in FilteredElementCollector(doc).OfClass(View3D):
        if not v.IsTemplate:
            return v
    return None

def foundation_shutter_m2(el, v3d, sides=4):
    # Dimensions
    b = get_param(el, ["b","B","Width"])
    d = get_param(el, ["h","H","Depth","Length"])
    h = get_param(el, ["Thickness","Foundation Thickness","Unconnected Height","Height"])
    if not h:
        try:
            bb = el.get_BoundingBox(v3d) if v3d else el.get_BoundingBox(None)
            h = bb.Max.Z - bb.Min.Z
        except:
            h = 0.0
    
    if not b or not d or not h:
        return 0.0
    
    # Convert to meters
    b_m, d_m, h_m = b*FT_TO_M, d*FT_TO_M, h*FT_TO_M

    # Perimeter depends on sides (4 or 3)
    per_m = (2*b_m + 2*d_m) * (sides/4.0)
    area_m2 = per_m * h_m
    return round(area_m2, 3)

# ---- MAIN ----
els_in = IN[0]
if not isinstance(els_in, list): els_in = [els_in]
els = [UnwrapElement(e) for e in els_in]
v3d = any_3d(doc)

# Set sides = 4 (كل الجوانب)، ممكن تغيّرها لـ 3 لو القاعدة ملتصقة بجانب
OUT = [foundation_shutter_m2(e, v3d, sides=4) for e in els]
# ----------------------------------------
create = List.Create(item0=getParameterValueByName, item1=getParameterValueByName_2, item2=python_script)
transpose = List.Transpose(lists=create)
exportToExcel = Data.ExportToExcel(filePath=file_path, sheetName=string, startRow=number, startColumn=number, data=transpose)
code_block = CodeBlock {  }

# group: Framing
string_4 = StringInput("Concrete.Beams")  # graph input
number_2 = DoubleInput(1)  # graph input
categories_2 = Categories("OST_StructuralFraming")  # graph input
all_elements_of_category_2 = ElementsOfCategory(Category=categories_2)
watch_2 = Watch(all_elements_of_category_2)
string_5 = StringInput("Reference Level")  # graph input
getParameterValueByName_3 = Element.GetParameterValueByName(element=watch_2, parameterName=string_5)
string_6 = StringInput("Volume")  # graph input
getParameterValueByName_4 = Element.GetParameterValueByName(element=watch_2, parameterName=string_6)
create_2 = List.Create(item0=getParameterValueByName_3, item1=getParameterValueByName_4)
transpose_2 = List.Transpose(lists=create_2)
exportToExcel_2 = Data.ExportToExcel(filePath=file_path, sheetName=string_4, startRow=number_2, startColumn=number_2, data=transpose_2)

# group: Floors
string_7 = StringInput("Concrete.Slab")  # graph input
number_3 = DoubleInput(1)  # graph input
categories_3 = Categories("OST_Floors")  # graph input
all_elements_of_category_3 = ElementsOfCategory(Category=categories_3)
watch_3 = Watch(all_elements_of_category_3)
string_8 = StringInput("Level")  # graph input
getParameterValueByName_5 = Element.GetParameterValueByName(element=watch_3, parameterName=string_8)
name = Material.Name(material=watch_3)
string_9 = StringInput("Area")  # graph input
getParameterValueByName_6 = Element.GetParameterValueByName(element=watch_3, parameterName=string_9)
string_10 = StringInput("Volume")  # graph input
getParameterValueByName_7 = Element.GetParameterValueByName(element=watch_3, parameterName=string_10)
create_3 = List.Create(item0=getParameterValueByName_5, item1=name, item2=getParameterValueByName_6, item3=getParameterValueByName_7)
transpose_3 = List.Transpose(lists=create_3)
exportToExcel_3 = Data.ExportToExcel(filePath=file_path, sheetName=string_7, startRow=number_3, startColumn=number_3, data=transpose_3)

# group: Walls - Plaster works
string_11 = StringInput("Plaster")  # graph input
number_4 = DoubleInput(1)  # graph input
categories_4 = Categories("OST_Walls")  # graph input
all_elements_of_category_4 = ElementsOfCategory(Category=categories_4)
string_12 = StringInput("Base Constraint")  # graph input
getParameterValueByName_8 = Element.GetParameterValueByName(element=all_elements_of_category_4, parameterName=string_12)
name_2 = Material.Name(material=all_elements_of_category_4)
المدخلات_قائمة_المواد_materials = Python(IN[0]=name_2)  # "# المدخلات: قائمة المواد (Materials) materials = IN[0] # القائمة المدخلة (أسماء المواد) # الكلمات المفتاحية للبحث keywords = ["CMU", "Brick", "Block"] # تصفية المواد بناءً على الكلمات المفتاحية filtered_materials = [] for material in materials: # تحقق إذا كانت أي كلمة مفتاحية موجودة في اسم المادة if any(keyword.lower() in str(material).lower() for keyword in keywords): filtered_materials.append(material) # إخراج المواد التي تطابق الشرط OUT = filtered_materials"; IronPython2
# ---------- المدخلات_قائمة_المواد_materials.python (14 lines) ----------
# المدخلات: قائمة المواد (Materials)
materials = IN[0]  # القائمة المدخلة (Material.Name)

# الكلمة المفتاحية لتصفية المواد
keyword = "Plaster"

# تصفية المواد بناءً على الكلمة المفتاحية
filtered_materials = [
    material for material in materials
    if keyword.lower() in str(material).lower()
]

# إخراج المواد المصفاة
OUT = filtered_materials
# ----------------------------------------
watch_4 = Watch(المدخلات_قائمة_المواد_materials)
string_13 = StringInput("Area")  # graph input
getParameterValueByName_9 = Element.GetParameterValueByName(element=all_elements_of_category_4, parameterName=string_13)
create_4 = List.Create(item0=getParameterValueByName_8, item1=watch_4, item2=getParameterValueByName_9)
transpose_4 = List.Transpose(lists=create_4)
المدخلات_الجدول_الناتج_المواد = Python(IN[0]=transpose_4)  # "# المدخلات: الجدول الناتج (المواد، الأدوار، المساحات) data = IN[0] # الجدول (List.Transpose الناتج) # تصفية الصفوف التي تحتوي على قيم null filtered_data = [] for row in data: if row[0] is not None: # تحقق إذا كانت المادة (column 0) ليست null filtered_data.append(row) # إخراج الصفوف المصفاة OUT = filtered_data"; IronPython2
# ---------- المدخلات_الجدول_الناتج_المواد.python (11 lines) ----------
# المدخلات: الجدول الناتج (List.Transpose الناتج)
data = IN[0]  # الجدول (كل صف يمثل [Level, Material, Area])

# تصفية الصفوف التي تحتوي على قيم null في العمود الثاني (Material)
filtered_data = []
for row in data:
    if row[1] is not None and row[1] != "":  # التحقق أن المادة ليست null أو فارغة
        filtered_data.append(row)

# إخراج الصفوف التي تحتوي فقط على مواد
OUT = filtered_data
# ----------------------------------------
watch_5 = Watch(المدخلات_الجدول_الناتج_المواد)
exportToExcel_4 = Data.ExportToExcel(filePath=file_path, sheetName=string_11, startRow=number_4, startColumn=number_4, data=watch_5)

# group: Walls - Block works
string_14 = StringInput("Masonary")  # graph input
number_5 = DoubleInput(1)  # graph input
categories_5 = Categories("OST_Walls")  # graph input
all_elements_of_category_5 = ElementsOfCategory(Category=categories_5)
string_15 = StringInput("Base Constraint")  # graph input
getParameterValueByName_10 = Element.GetParameterValueByName(element=all_elements_of_category_5, parameterName=string_15)
name_3 = Material.Name(material=all_elements_of_category_5)
python_script_2 = Python(IN[0]=name_3)  # CPython3
# ---------- python_script_2.python (15 lines) ----------
# المدخلات: قائمة المواد (Materials)
materials = IN[0]  # القائمة المدخلة (Material.Name)

# الكلمات المفتاحية لتصفية المواد
keywords = ["CMU", "Brick", "Block"]

# تصفية المواد بناءً على الكلمات المفتاحية
filtered_materials = []
for material in materials:
    # تحقق إذا كانت أي كلمة مفتاحية موجودة في المادة
    if any(keyword.lower() in str(material).lower() for keyword in keywords):
        filtered_materials.append(material)

# إخراج المواد المصفاة
OUT = filtered_materials
# ----------------------------------------
watch_6 = Watch(python_script_2)
string_16 = StringInput("Area")  # graph input
getParameterValueByName_11 = Element.GetParameterValueByName(element=all_elements_of_category_5, parameterName=string_16)
create_5 = List.Create(item0=getParameterValueByName_10, item1=watch_6, item2=getParameterValueByName_11)
transpose_5 = List.Transpose(lists=create_5)
python_script_3 = Python(IN[0]=transpose_5)  # CPython3; same code as المدخلات_الجدول_الناتج_المواد
watch_7 = Watch(python_script_3)
exportToExcel_5 = Data.ExportToExcel(filePath=file_path, sheetName=string_14, startRow=number_5, startColumn=number_5, data=watch_7)

# group: Windows
string_17 = StringInput("Windows")  # graph input
number_6 = DoubleInput(1)  # graph input
categories_6 = Categories("OST_Windows")  # graph input
all_elements_of_category_6 = ElementsOfCategory(Category=categories_6)
watch_8 = Watch(all_elements_of_category_6)
string_18 = StringInput("Level")  # graph input
getParameterValueByName_12 = Element.GetParameterValueByName(element=watch_8, parameterName=string_18)
name_4 = Material.Name(material=watch_8)
create_6 = List.Create(item0=getParameterValueByName_12, item1=name_4)
transpose_6 = List.Transpose(lists=create_6)
exportToExcel_6 = Data.ExportToExcel(filePath=file_path, sheetName=string_17, startRow=number_6, startColumn=number_6, data=transpose_6)

# group: Doors
string_19 = StringInput("Doors")  # graph input
number_7 = DoubleInput(1)  # graph input
categories_7 = Categories("OST_Doors")  # graph input
all_elements_of_category_7 = ElementsOfCategory(Category=categories_7)
watch_9 = Watch(all_elements_of_category_7)
string_20 = StringInput("Level")  # graph input
getParameterValueByName_13 = Element.GetParameterValueByName(element=watch_9, parameterName=string_20)
name_5 = Material.Name(material=watch_9)
create_7 = List.Create(item0=getParameterValueByName_13, item1=name_5)
transpose_7 = List.Transpose(lists=create_7)
exportToExcel_7 = Data.ExportToExcel(filePath=file_path, sheetName=string_19, startRow=number_7, startColumn=number_7, data=transpose_7)

# group: Columns
string_21 = StringInput("Concrete.Columns")  # graph input
number_8 = DoubleInput(1)  # graph input
categories_8 = Categories("OST_StructuralColumns")  # graph input
all_elements_of_category_8 = ElementsOfCategory(Category=categories_8)
watch_10 = Watch(all_elements_of_category_8)
string_22 = StringInput("Top Level")  # graph input
getParameterValueByName_14 = Element.GetParameterValueByName(element=watch_10, parameterName=string_22)
python_script_4 = Python(IN[0]=all_elements_of_category_8)  # CPython3
# ---------- python_script_4.python (84 lines) ----------
# Dynamo Python 3.x (PRODUCTION - Shuttering Area only)
import clr, math
clr.AddReference("RevitAPI")
from Autodesk.Revit.DB import *
clr.AddReference("RevitServices")
from RevitServices.Persistence import DocumentManager
clr.AddReference("RevitNodes")
import Revit
clr.ImportExtensions(Revit.Elements)

doc = DocumentManager.Instance.CurrentDBDocument
FT_TO_M = 0.3048

def get_param(el, names):
    # instance then type
    for n in names:
        p = el.LookupParameter(n)
        if p and p.StorageType != StorageType.String:
            try: return p.AsDouble()
            except: pass
    s = getattr(el, "Symbol", None)
    if s:
        for n in names:
            p = s.LookupParameter(n)
            if p and p.StorageType != StorageType.String:
                try: return p.AsDouble()
                except: pass
    return None

def any_3d(doc):
    for v in FilteredElementCollector(doc).OfClass(View3D):
        if not v.IsTemplate: return v
    return None

def height_ft(el, v3d):
    h = get_param(el, ["Unconnected Height","Height","ارتفاع"])
    if h and h>0: return h
    try:
        bl = el.LookupParameter("Base Level")
        tl = el.LookupParameter("Top Level")
        b_off = get_param(el, ["Base Offset","Base Offset Value"]) or 0.0
        t_off = get_param(el, ["Top Offset","Top Offset Value"]) or 0.0
        if bl and tl:
            b = doc.GetElement(bl.AsElementId()); t = doc.GetElement(tl.AsElementId())
            if b and t:
                val = (t.Elevation + t_off) - (b.Elevation + b_off)
                if val>0: return val
    except: pass
    try:
        bb = el.get_BoundingBox(v3d) if v3d else el.get_BoundingBox(None)
        if bb:
            dz = bb.Max.Z - bb.Min.Z
            if dz>0: return dz
    except: pass
    return 0.0

def perimeter_ft(el, v3d):
    b = get_param(el, ["b","B","Width","عرض"])
    d = get_param(el, ["h","H","Depth","عمق"])
    if b and d and b>0 and d>0: return 2.0*(b+d)
    dia = get_param(el, ["Diameter","D","قطر"])
    if dia and dia>0: return math.pi*dia
    try:
        bb = el.get_BoundingBox(v3d) if v3d else el.get_BoundingBox(None)
        if bb:
            dx = bb.Max.X - bb.Min.X
            dy = bb.Max.Y - bb.Min.Y
            if dx>0 and dy>0: return 2.0*(dx+dy)
    except: pass
    return 0.0

# MAIN
els_in = IN[0]
if not isinstance(els_in, list): els_in = [els_in]
els = [UnwrapElement(e) for e in els_in]
v3d = any_3d(doc)

areas = []
for el in els:
    per_ft = perimeter_ft(el, v3d)
    h_ft   = height_ft(el, v3d)
    areas.append(round((per_ft*FT_TO_M)*(h_ft*FT_TO_M), 3) if per_ft>0 and h_ft>0 else 0.0)

OUT = areas
# ----------------------------------------
string_23 = StringInput("Volume")  # graph input
getParameterValueByName_15 = Element.GetParameterValueByName(element=watch_10, parameterName=string_23)
create_8 = List.Create(item0=getParameterValueByName_14, item1=python_script_4, item2=getParameterValueByName_15)
transpose_8 = List.Transpose(lists=create_8)
exportToExcel_8 = Data.ExportToExcel(filePath=file_path, sheetName=string_21, startRow=number_8, startColumn=number_8, data=transpose_8)
